vi "index.gviweb"   [G Web Development Software 22.0.0]
uses:
  WebApp::Support::Common.jsli::SetInnerHTML
  WebApp::Support::Common.jsli::ClearClassFromAll
  WebApp::Support::Auth::GET User Info.gvi
  WebApp::Support::Common.jsli::SetUser
diagram:
  w1 = """The <b>Summer of LabVIEW</b> is a global NI Sales and Support event to increase <i>awareness, excitement</i>, and <i>prowess</i> with LabVIEW through a series of <b>coding challenges</b>, preceded by presentations and workshops teaching concepts that are applicable to the coding challenge tasks. Join the conversation about the event on <a href="https://web.yammer.com/main/org/ni.com/groups/eyJfdHlwZSI6Ikdyb3VwIiwiaWQiOiIxMDUxNDYzNzYxOTIifQ/all" target="_blank">our Yammer page</a>.<br>
<br>
You can also find information on our sharepoint where there are all of the training session recordings as well as recordings of challenge introductions and how to use the website: <a href="https://nio365.sharepoint.com/sites/SummerofLabVIEW" target="_blank">Summer of LabVIEW SharePoint</a>.<br>
<br>
To prepare for the event, you'll need to install LabVIEW 2020 or later. Download LabVIEW <a href="https://www.ni.com/en-us/support/downloads/software-products/download.labview.html#443865" target="_blank">here</a>.<br>
<br>
For the first challenge, you will also need to install DQMH from the VIPM Community <a href="https://www.vipm.io/package/delacor_lib_dqmh_toolkit/" target="_blank">here</a>.<br>
<br>
<hr>
<br>
This website is run on a web server written entirely in LabVIEW with the client side developed using the G Web Development software. You can find the source at <a href="https://github.com/illuminated-g/lv-sol-22" target="_blank">https://github.com/illuminated-g/lv-sol-22</a>. The underlying libraries used for the server will be available on VIPM this Summer."""
  Obtain JavaScript Reference(reference in=reference to "HTML Container") -> (javascript reference out=w2)
  call "SetInnerHTML"(placeholder=w2, html=w1)
  s1 = "Init"  # shift register
  while {
    case (s1) {
      frame "Init" {
        w3 = "Ready"
      }
      frame "Ready" {
        call "ClearClassFromAll"(className="initially-hidden")
        call "GET User Info.gvi"() -> (Logged In=w4, User JSON=w5)
        call "SetUser"(loggedIn=w4, userJSON=w5)
        w3 = "Run"
      }
      frame "Run" {
        Wait(time to wait=100)
        w3 = "Run"
      }
    }
    next s1 = w3
    stop if FALSE
  }
