vi "submit.gviweb"   [G Web Development Software 22.0.0]
panel controls:
  "Upload File": bool
uses:
  WebApp::Support::Common.jsli::AddNavLink
  URL::Window Location::Window Location Parameters::Window Location Get Search Parameter.gvi
  WebApp::Support::Common.jsli::SetInnerHTML
  WebApp::Support::Challenges::GET Challenge by ID.gvi
  WebApp::Support::Common.jsli::ClearClassFromAll
  WebApp::Support::Challenges::Set Challenge Details.gvi
  WebApp::Support::Auth::Make CSRF Token.gvi
  Uppy::Set Uppy Core Options.gvi
  Uppy::Set Uppy Dashboard Options.gvi
  Uppy::Request Files.gvi
  WebApp::Support::Submit::UploadFile.gvi
diagram:
  s1 = "Init"  # shift register
  s2 = uninitialised  # shift register
  s3 = uninitialised  # shift register
  while {
    case (s1) {
      frame "Init" {
        call "AddNavLink"(url="/help.html", text="Help!")
        call "Window Location Get Search Parameter.gvi"(key="id") -> (value=w4)
        Decimal String To Number(default (0 I32)=0, string=w4) -> (number=w3)
        w1 = "Ready"
        w2 = default
      }
      frame "Ready" {
        Is Greater Than 0(x=s3) -> w5
        w6 = """There was an error loading the specified challenge. Try reloading the page.

If the problem persists check out the <a href="/help.html">help</a> page."""
        case (w5) {
          frame False, Default {
            Obtain JavaScript Reference(reference in=reference to "Description") -> (javascript reference out=w7)
            call "SetInnerHTML"(placeholder=w7, html=w6)
          }
          frame True {
            call "GET Challenge by ID.gvi"(ID=s3) -> (Challenge=w8, Found?=w9)
            Obtain JavaScript Reference(reference in=reference to "Description") -> (javascript reference out=w10)
            case (w9) {
              frame False, Default {
                call "SetInnerHTML"(placeholder=w10, html=w6)
              }
              frame True {
                call "ClearClassFromAll"(className="initially-hidden")
                call "Set Challenge Details.gvi"(Challenge=w8, Desc Ref=w10, Name Ref=reference to unnamed text)
              }
            }
          }
        }
        call "Make CSRF Token.gvi"(Token ID="submit") -> (Token=w2)
        w1 = "Run"
        w3 = s3
      }
      frame "Run" {
        event {
          on "Upload File" Value changed {
            call "Set Uppy Core Options.gvi"(max number of files=1, allowed file types=[".llb"]) -> (uppy options out=w11)
            call "Set Uppy Dashboard Options.gvi"(uppy options in=w11, show uppy icon?=FALSE) -> (uppy options out=w12)
            call "Request Files.gvi"(uppy options=w12) -> (file references=w13)
            Array Index(array=w13) -> (out0[_]=w14)
            call "UploadFile.gvi"(File=w14, Challenge ID=s3, CSRF Token=s2) -> (error out=w15)
            case (w15) {
              frame Error, Default {
                Property Node(instance in=w15) -> ("source"=w16)
                One Button Dialog(message=w16)
              }
              frame No Error { }
            }
          }
        }
        w1 = "Run"
        w2 = default
        w3 = default
      }
    }
    next s1 = w1
    next s2 = w2
    next s3 = w3
    stop if FALSE
  }
